# Grasshopper definition Grass001.gh (Grasshopper 1.0.7)

construct_point = ConstructPoint(XCoordinate=0, YCoordinate=0, ZCoordinate=0)
construct_point_2 = ConstructPoint(XCoordinate=Slider(17, range=0..100), YCoordinate=0, ZCoordinate=0)
line = Line(StartPoint=construct_point, EndPoint=construct_point_2)
brep = Brep(<brep referenced from the Rhino model>)
deconstruct_brep = DeconstructBrep(Brep=brep)  # -> Faces, Edges, Vertices
polar_array = PolarArray(Geometry=construct_point_2, Plane=PlaneXY(0, 0, 0), Count=Slider(6, range=0..10), Angle=6.283185307)  # -> Geometry, Transform
list_item = ListItem(List=deconstruct_brep.Edges, Index=expr("x+3", Slider(11, range=0..100)), Wrap=True)
geometry = Geometry(list_item)
polyline = PolyLine(Closed=False)
interpolate = Interpolate(Vertices=polar_array.Geometry, Degree=3, Periodic=True, KnotStyle=1)  # -> Curve, Length, Domain
polyline_2 = PolyLine(Vertices=polar_array.Geometry, Closed=Toggle(True))
pipe = Pipe(Curve=polyline_2, Radius=Slider(5.1, range=0..10), Caps=0)
length = Length(Curve=geometry)
panel = Panel(length)
